# Grasshopper definition viewer.gh (Grasshopper 1.0.7)
# plug-ins: AureconGrasshopper

path = FilePath("E:\User Files\Repos\hex-lerp\Hex.Geometry.Tests\rhino\exports\")
files = FilesInDirectory(Directory=path)
file = ReadFile(File=files, PerLineParse=True)
split = TextSplit(Text=file, Separators=",")
polygon = Polygon(Plane=PlaneXY(0, 0, 0), Radius=Slider(0.56, range=0..1), Segments=6, FilletRadius=0)  # -> Polygon, Length
item = ListItem(List=split, Index=0, Wrap=True)  # -> Item, Item1, Item2
rotate = Rotate(Geometry=polygon.Polygon, Angle=1.570796327, Plane=PlaneXY(0, 0, 0))  # -> Geometry, Transform
pt = ConstructPoint(XCoordinate=item.Item, YCoordinate=item.Item1, ZCoordinate=item.Item2)
mesh = Mesh(rotate.Geometry)
move = Move(Geometry=mesh, Motion=pt)  # -> flatten(Geometry), Transform
mjoin = MeshJoin(Meshes=move.Geometry)
